% Simulink data dictionary DataDictionary.sldd

designSpline1 = Simulink.Bus()
  f: double[1001]
  d: double[1001]
  s: double[1001]
  t: double[1001]

designSpline2 = Simulink.Bus()
  f: double[1001]
  d: double[1001]
  s: double[1001]
  t: double[1001]

designSplineTotal = Simulink.Bus()
  designSpline1: Bus: designSpline1
  designSpline2: Bus: designSpline2

keyEvent1 = Simulink.Bus()
  keyEvent1Number: double
  keyEvent1Phase: double[6]
  keyEvent1y: double[6]
  keyEvent1dy: double[6]

keyEvent2 = Simulink.Bus()
  keyEvent2Number: double
  keyEvent2Phase: double[6]
  keyEvent2y: double[6]
  keyEvent2dy: double[6]

keyEventTotal = Simulink.Bus()
  KeyEvent2: Bus: keyEvent2
  KeyEvent1: Bus: keyEvent1

numberSamplePoints = 1001